# Dynamo graph Set Parent-Child IDs.dyn (Dynamo 1.3.2.2480)

# group: Select Parent
select_parent = DSModelElementSelection()  # 1 picked in the model

code_block = CodeBlock { "Child IDs"; }
getParameterValueByName = Element.GetParameterValueByName(element=select_parent, parameterName=code_block)
code_block_2 = CodeBlock { ","; }

# group: Select Children
select_children = DSModelElementsSelection()  # 2 picked in the model

id = Element.Id(select_children)
string_from_object = FromObject(id)
join = String.Join(code_block_2, string_from_object)
join_2 = String.Join(arg1=getParameterValueByName, arg2=join)  # unwired: arg0

# group: Add new Children IDs to parent
code_block_3 = CodeBlock { "Child IDs"; }
setParameterByName = Element.SetParameterByName(element=select_parent, parameterName=code_block_3, value=join_2)

code_block_4 = CodeBlock { ","; }
id_2 = Element.Id(select_parent)
string_from_object_2 = FromObject(id_2)
join_3 = String.Join(code_block_4, string_from_object_2)

# group: Update Parent ID in all Children
code_block_5 = CodeBlock { "Parent IDs"; }
setParameterByName_2 = Element.SetParameterByName(element=select_children, parameterName=code_block_5, value=join_3)
